test file "regressionTests"

suite "Windows Tests"
  setup callback:
    % Build S-Function
    buildSFun;

    % Add Win binaries to path
    if isfolder(fullfile(projFolder,'_install_win'))
        addpath(fullfile(projFolder,'_install_win'));
    elseif ~isempty(getenv('ECAL_HOME'))
        % do nothing
    else
        error('eCAL binaries for Windows not found.');
    end

  case "Basic Simulink functionality" [simulation]
    model ecal_simulink_toolbox_dummy, mode Normal, stop time 0

suite "SLRT Tests"

  case "Build test" [simulation]
    model ecal_simulink_toolbox_dummy, stop time 0
    post-load callback:
      rtwbuild(sltest_bdroot,'generateCodeOnly',false);